# Dynamo graph jdos_table_coords2.dyn (Dynamo 3.6.0.9395)

string = StringInput("TABELA_VEGETAÇÂO")
categories = Categories("OST_Planting")  # graph input
all_elements_of_category = ElementsOfCategory(Category=categories)
code_block = CodeBlock { IfcGUID; }  # unwired: IfcGUID
getParameterValueByName = Element.GetParameterValueByName(parameterName=code_block)  # unwired: element
sortByFunction = List.SortByFunction(list=all_elements_of_category, sortFunction=getParameterValueByName)
python_script = Python(IN[0]=sortByFunction)  # CPython3
# ---------- python_script.python (43 lines) ----------
from Autodesk.Revit.DB import *
from RevitServices.Persistence import DocumentManager
import math

elements = IN[0]

doc = DocumentManager.Instance.CurrentDBDocument
# Obter localização do projeto
project_location = doc.ActiveProjectLocation
transform = project_location.GetTransform()

# Listas vazias
dados = []
texto= ''
teste=False

tabela = [["Nome", "ID", "X", "Y", "Z"]]  # Cabeçalho

for elem in elements:
    texto=elem.Name+","+str(elem.Id)+","+str(elem.Location)
    texto=texto.replace("Point(","")
    texto=texto.replace(")","")
    dados.append(texto)
    elementos = texto.split(",")
    x=elementos[2].replace("X = ","")
    y=elementos[3].replace(" Y = ","")
    z=elementos[4].replace(" Z = ","")
    
    tabela.append([
                    elementos[0],
                    elementos[1],
                    x,  # metros
                    y,
                    z,
                ])

   # dados.append(elem.Name)
    if("Bordo" in elem.Name):
        teste=True
    

# Retornar dados
OUT = tabela
# ----------------------------------------
watch = Watch(python_script)
watch_2 = Watch(all_elements_of_category)
schedule_type = ScheduleTypes("RegularSchedule")
python_script_2 = Python(IN[0]=python_script)  # CPython3
# ---------- python_script_2.python (44 lines) ----------
import clr
clr.AddReference('RevitAPI')
clr.AddReference('RevitServices')
from Autodesk.Revit.DB import *
from RevitServices.Persistence import DocumentManager
import math


doc = DocumentManager.Instance.CurrentDBDocument

# Obter localização do projeto
project_location = doc.ActiveProjectLocation
site_location = doc.SiteLocation

# Transformação para coordenadas compartilhadas
transform = project_location.GetTransform()

table = IN[0]



def xyz_to_latlon(x, y, z):
    # Criar ponto XYZ (em pés)
    pt = XYZ(x, y, z)
    
    # Transformar para coordenadas compartilhadas
    pt_compartilhado = transform.OfPoint(pt)
    
    # Obter posição geográfica
    pos = project_location.GetProjectPosition(pt)
    
    # Converter para graus
    latitude = pos.Angle * (180 / math.pi)
    longitude = pos.EastWest * (180 / math.pi)
    elevacao = pos.Elevation * 0.3048  # metros
    
    return latitude, longitude, elevacao
   
linha=''
for l in table:
    linha=l
    teste=xyz_to_latlon(l[2],l[3],l[4])

OUT = linha,teste
# ----------------------------------------
watch_3 = Watch(python_script_2)
getLocation = Element.GetLocation(element=sortByFunction)
watch_4 = Watch(getLocation)
coords = Python(IN[0]=python_script)  # CPython3
# ---------- coords.python (14 lines) ----------
# Criar ponto a partir de coordenadas
import clr
clr.AddReference('ProtoGeometry')
from Autodesk.DesignScript.Geometry import Point

table = IN[0]
del table[0]
linha=''
coords=[]
for l in table:
    linha=l
    coords.append(Point.ByCoordinates(float(l[2]),float(l[3]),float(l[4])))

OUT = coords
# ----------------------------------------
watch_5 = Watch(coords)
surveyPoint = Coordinates.SurveyPoint()
byOrigin = CoordinateSystem.ByOrigin(origin=surveyPoint)
identity = CoordinateSystem.Identity()
transform = Geometry.Transform(geometry=coords, fromCoordinateSystem=byOrigin, contextCoordinateSystem=identity)
python_script_3 = Python(IN[0]=all_elements_of_category, IN[1]=transform)  # CPython3
# ---------- python_script_3.python (47 lines) ----------
import clr
clr.AddReference('RevitAPI')
clr.AddReference('RevitServices')
from RevitServices.Persistence import DocumentManager
from RevitServices.Transactions import TransactionManager
from Autodesk.Revit.DB import *

# Inputs do Dynamo
elementos = IN[0]  # Lista de elementos
coordenadas = IN[1]  # Lista de coordenadas (pontos XYZ ou lista de listas [x,y])

# Documento ativo
doc = DocumentManager.Instance.CurrentDBDocument

# Iniciar transação
TransactionManager.Instance.EnsureInTransaction(doc)

resultados = []

for i, elem in enumerate(elementos):
    try:
        # Obter coordenadas X e Y
        if hasattr(coordenadas[i], 'X'):  # Se for um ponto XYZ
            x_valor = coordenadas[i].X
            y_valor = coordenadas[i].Y
        else:  # Se for uma lista [x, y]
            x_valor = coordenadas[i][0]
            y_valor = coordenadas[i][1]
        
        # Definir parâmetro X
        param_x = elem.LookupParameter("x_arvore")
        if param_x and not param_x.IsReadOnly:
            param_x.Set(x_valor)
        
        # Definir parâmetro Y
        param_y = elem.LookupParameter("y_arvore")
        if param_y and not param_y.IsReadOnly:
            param_y.Set(y_valor)
        
        resultados.append("Sucesso")
    except Exception as e:
        resultados.append(str(e))

# Finalizar transação
TransactionManager.Instance.TransactionTaskDone()

OUT = resultados
# ----------------------------------------
watch_6 = Watch(python_script_3)
parametro_e = StringInput("E")  # graph input
E = Point.X(point=transform)
string_from_object = FromObject(object=E)
setParameterByName = Element.SetParameterByName(element=sortByFunction, parameterName=parametro_e, value=string_from_object)
code_block_2 = CodeBlock { "N"; }
parametro_n = StringInput("N")  # graph input
N = Point.Y(point=transform)
string_from_object_2 = FromObject(object=N)
setParameterByName_2 = Element.SetParameterByName(element=sortByFunction, parameterName=parametro_n, value=string_from_object_2)
string_2 = StringInput("N")
createSharedParameter = Parameter.CreateSharedParameter(parameterName=string_2, categoryList=all_elements_of_category)  # unwired: groupName, specType, groupType, instance
INFO = StringInput("Crie os dois parâmetros  - podendo ser de projeto ou compartilhado antes de executar")  # graph input; graph output
